# Grasshopper definition GHToDynamo.gh (Grasshopper 0.9.76)
# plug-ins: Python Interpreter

casefromfolder = Butterfly_CreateCaseFromFolder()  # -> readMe, case; plug-in component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
path = FilePath("C:\Users\Administrator\AppData\Roaming\Dynamo\Dynamo Core\1.2\definitions")
panel = Panel("*")
components = PythonScript(components=casefromfolder.case, path=path, export=Toggle(False))  # -> readMe; inputs components: list, export: Boolean
# ---------- components: Python ----------
"""
Export Ladybug Analysis Tools Python Components to Dynamo

    Args:
        _components: Any output from a new Ladybug (or Honeybee) component that you wish to export. Right now, only one component can be connected at a time but you can input a "*" (without quotation marsk) to search all changed Ladybug components on a grasshopper canvas.
        _path: A file path on your system which you would like to export the user object and source code to.  For most code developers, this file path will lead to their Github folder for Ladybug (or Honeybee), which is usually installed in "My Documents" by default. Exported source code will be saved at .\src and exported userObjects will be saved at .\userObjects in this _targetFolder.
        _export: Set to "True" to export Ladybug (or Honeybee) components to the _targerFolder.
    Returns:
        readMe!: ...
"""

def getAllTheComponents(onlyGHPython = True):
    components = []
    
    document = ghenv.Component.OnPingDocument()
    
    for component in document.Objects:
        if onlyGHPython and type(component)!= type(ghenv.Component):
            pass
        else:
            components.append(component)
    
    return components

def getListOfConnectedComponents(componentInputParamIndex = 0, onlyGHPython = True):

    components = []
    
    param = ghenv.Component.Params.Input[componentInputParamIndex]
    sources = param.Sources
    
    if sources.Count == 0:
        return components
    
    for source in sources:
        attr = source.Attributes
        if (attr is None) or (attr.GetTopLevel is None):
            component = None
        else:
            component = attr.GetTopLevel.DocObject
        
        if component == None or (onlyGHPython and type(component) != type(ghenv.Component)):
                #collect only python components
                pass
        else:
            components.append(component)
    
    return components

import grasshopper_component
reload(grasshopper_component)
from grasshopper_component import Component
import dynamo_custom_node
reload(dynamo_custom_node)
from dynamo_custom_node import nodeFromComponent

plugins = ('Ladybug', 'Honeybee', 'Butterfly')
if _export and _components and _path:
    
    if str(_components[0]) == "*":
        ghComps = getAllTheComponents()
    else:
        ghComps = getListOfConnectedComponents()
    
    for ghComp in ghComps:
        if ghComp.Name.split('_')[0] in plugins:
            nodeFromComponent(Component.fromGHComponent(ghComp), _path)
# ---------- end components ----------
panel_2 = Panel(components)
